# Grasshopper definition HappyShield3DScanValidation.gh (Grasshopper 1.0.7)

# ----
# Read Me: Date Created: 2021 01 13
# Contact: Aurimas Bukauskas (ab2005@cam.ac.uk).
# 
# This file supports the following publication:
# 
# Bukauskas, A., Koronaki, A., Lee, T.-U., Ott, D., Al Asali, M.W., Jalia, A., Bashford, T., Gatoó, A., Newman, J., Gattas, Joseph M., Shah, Darshil U., Ramage, Michael H., 2021. Curved-crease origami face shields for infection control. PLOS ONE.
# 
# This file shows the procedure used for the comparison of the analytical geometry prediction and a 3D scan mesh of a curved-crease origami face shield design described in the above paper.
# 
# For further information, or if you discover an error in this file, please contact Aurimas Bukauskas (ab2005@cam.ac.uk).
# 3D Scan Mesh
_3d_scan_mesh = Mesh(<mesh referenced from the Rhino model>)

centre_top_front_visor_interface = Point(Point(0, -108.9937859, -16.11015842))
centre_forehead_rest_top = Point(Point(73.58266163, -19.17656271, 35.35005188))
front_visor_top_centre = Point(Point(0, -136.9980226, 15.18237493))
middle_right_internal = Point(Point(-64.77234381, -109.2996911, -78.1436145))
middle_left_internal = Point(Point(64.77234381, -109.2996911, -78.1436145))
front_visor_centre = Point(Point(0, -143.7801965, -75.56669796))
middle_right_edge = Point(Point(-95, -20.87498454, -39.12410498))
# Extraction Points on Surface
# of Analytical Geometry Prediction
top_right_corner = Point(Point(-95, -13.68331007, 57.10430099))
middle_left_edge = Point(Point(95, -20.87498454, -39.12410498))
top_left_corner = Point(Point(95, -13.68331007, 57.10430099))
bottom_centre = Point(Point(0, -150.5623705, -166.3157709))

# ----
# Visualisation
swatch = ColourSwatch(SwatchColor=RGB(255, 255, 230))
number_slider = Slider(0.6, range=0..1)
number_slider_2 = Slider(4, range=0..10)
extraction_points_on_analytically_genera = Point([top_right_corner, top_left_corner, bottom_centre, front_visor_top_centre, front_visor_centre, middle_right_edge, middle_left_edge, centre_top_front_visor_interface, middle_right_internal, middle_left_internal, centre_forehead_rest_top])  # "Extraction Points on Analytically Generated Surface"
sph = Sphere(Base=extraction_points_on_analytically_genera, Radius=number_slider_2)
material = CreateMaterial(
    Diffuse=ColourSwatch(SwatchColor=RGBA(0, 0, 255, 205)),
    Specular=swatch,
    Emission=RGB(0, 0, 0),
    Transparency=number_slider,
    Shine=0)
preview = CustomPreview(Geometry=sph, Material=material)

# ----
# Corresponding Points on 3D Scan Mesh
# Selected using MeshClosestPoint
meshcp = MeshClosestPoint(Point=bottom_centre, Mesh=_3d_scan_mesh)  # -> Point, Index, Parameter
meshcp_2 = MeshClosestPoint(Point=front_visor_top_centre, Mesh=_3d_scan_mesh)  # -> Point, Index, Parameter
meshcp_3 = MeshClosestPoint(Point=front_visor_centre, Mesh=_3d_scan_mesh)  # -> Point, Index, Parameter
meshcp_4 = MeshClosestPoint(Point=middle_right_edge, Mesh=_3d_scan_mesh)  # -> Point, Index, Parameter
meshcp_5 = MeshClosestPoint(Point=middle_left_edge, Mesh=_3d_scan_mesh)  # -> Point, Index, Parameter
meshcp_6 = MeshClosestPoint(Point=centre_top_front_visor_interface, Mesh=_3d_scan_mesh)  # -> Point, Index, Parameter
meshcp_7 = MeshClosestPoint(Point=middle_right_internal, Mesh=_3d_scan_mesh)  # -> Point, Index, Parameter
meshcp_8 = MeshClosestPoint(Point=middle_left_internal, Mesh=_3d_scan_mesh)  # -> Point, Index, Parameter
centre_top_front_visor_interface_2 = Point(meshcp_6.Point)
front_visor_top_centre_2 = Point(meshcp_2.Point)
middle_right_internal_2 = Point(meshcp_7.Point)
middle_left_internal_2 = Point(meshcp_8.Point)
front_visor_centre_2 = Point(meshcp_3.Point)
middle_right_edge_2 = Point(meshcp_4.Point)
middle_left_edge_2 = Point(meshcp_5.Point)
bottom_centre_2 = Point(meshcp.Point)

# ----
# Selected Manually
centre_forehead_rest_top_2 = Point(Point(60.42943802, -15.3392365, 33.6212614))
top_right_corner_2 = Point(Point(-108.5142658, -19.96462063, 57.9231725))
top_left_corner_2 = Point(Point(103.8661359, -11.76015916, 51.62056449))

# ----
# Visualisation
corresponding_points_on_3d_scan_mesh = Point([middle_right_internal_2, middle_left_internal_2, top_right_corner_2, top_left_corner_2, bottom_centre_2, front_visor_top_centre_2, front_visor_centre_2, middle_right_edge_2, centre_top_front_visor_interface_2, middle_left_edge_2, centre_forehead_rest_top_2])
material_2 = CreateMaterial(
    Diffuse=ColourSwatch(SwatchColor=RGBA(255, 0, 0, 205)),
    Specular=swatch,
    Emission=RGB(0, 0, 0),
    Transparency=number_slider,
    Shine=0)
sph_2 = Sphere(Base=corresponding_points_on_3d_scan_mesh, Radius=number_slider_2)
preview_2 = CustomPreview(Geometry=sph_2, Material=material_2)

dist = Distance(PointA=top_right_corner, PointB=top_right_corner_2)
dist_2 = Distance(PointA=top_left_corner, PointB=top_left_corner_2)
dist_3 = Distance(PointA=centre_forehead_rest_top, PointB=centre_forehead_rest_top_2)
panel = Panel(dist)
panel_2 = Panel(dist_3)
panel_3 = Panel(dist_2)

# ----
# Distance Between Extraction
# Points and Corresponding Points [mm]
dist_4 = Distance(PointA=bottom_centre, PointB=bottom_centre_2)
dist_5 = Distance(PointA=front_visor_top_centre, PointB=front_visor_top_centre_2)
dist_6 = Distance(PointA=front_visor_centre, PointB=front_visor_centre_2)
dist_7 = Distance(PointA=middle_right_edge, PointB=middle_right_edge_2)
dist_8 = Distance(PointA=middle_left_edge, PointB=middle_left_edge_2)
dist_9 = Distance(PointA=centre_top_front_visor_interface, PointB=centre_top_front_visor_interface_2)
dist_10 = Distance(PointA=middle_right_internal, PointB=middle_right_internal_2)
dist_11 = Distance(PointA=middle_left_internal, PointB=middle_left_internal_2)
panel_4 = Panel(dist_4)
panel_5 = Panel(dist_5)
panel_6 = Panel(dist_6)
panel_7 = Panel(dist_7)
panel_8 = Panel(dist_8)
panel_9 = Panel(dist_9)
panel_10 = Panel(dist_10)
panel_11 = Panel(dist_11)

# ----
# Distance Divided By Material Thickness
material_thickness_mm = Panel("0.510")

division = Division(A=panel_4, B=material_thickness_mm)
division_2 = Division(A=panel_5, B=material_thickness_mm)
division_3 = Division(A=panel_6, B=material_thickness_mm)
division_4 = Division(A=panel_7, B=material_thickness_mm)
division_5 = Division(A=panel_8, B=material_thickness_mm)
division_6 = Division(A=panel_9, B=material_thickness_mm)
division_7 = Division(A=panel_10, B=material_thickness_mm)
division_8 = Division(A=panel_11, B=material_thickness_mm)
panel_12 = Panel(division_7)
panel_13 = Panel(division_8)
panel_14 = Panel(division)
panel_15 = Panel(division_2)
panel_16 = Panel(division_3)
panel_17 = Panel(division_4)
panel_18 = Panel(division_5)
panel_19 = Panel(division_6)

division_9 = Division(A=panel, B=material_thickness_mm)
division_10 = Division(A=panel_3, B=material_thickness_mm)
division_11 = Division(A=panel_2, B=material_thickness_mm)
panel_20 = Panel(division_11)
panel_21 = Panel(division_9)
panel_22 = Panel(division_10)
